# Dynamo graph Formwork-quantity-takeoff.dyn (Dynamo 2.1.0.7500)

select_model_elements = DSModelElementsSelection()  # 149 picked in the model

# group: FOUNDATION CALCULATION
getCategory = Element.GetCategory(element=select_model_elements)
string_from_object = FromObject(obj=getCategory)
code_block = CodeBlock { "Structural Foundations"; }
contains = String.Contains(str=string_from_object, searchFor=code_block)
filterByBoolMask = List.FilterByBoolMask(list=select_model_elements, mask=contains)
code_block_2 = CodeBlock(foundation=filterByBoolMask.in) { foundation; }
code_block_3 = CodeBlock { "Area Formwork"; }
geometry = Element.Geometry(element=code_block_2)
explode = Geometry.Explode(geometry=geometry)
code_block_4 = CodeBlock { "Surface"; }
removeIfNot = List.RemoveIfNot(list=explode@L2, type=code_block_4)
boolean = BoolSelector(false)
clean = List.Clean(list=removeIfNot, preserveIndices=boolean)
code_block_5 = CodeBlock { 0.5; }
normalAtParameter = Surface.NormalAtParameter(surface=clean, u=code_block_5, v=code_block_5)
ZAxis = Vector.ZAxis()
isParallel = Vector.IsParallel(vector=normalAtParameter, other=ZAxis)
filterByBoolMask_2 = List.FilterByBoolMask(list=clean, mask=isParallel)
code_block_6 = CodeBlock(Foundation=filterByBoolMask_2.out) { Foundation; }
area = Surface.Area(surface=code_block_6)
sum = Math.Sum(values=area)
round = Math.Round(number=sum)
convert_between_units = DynamoConvert(round, MeasurementType="Area", FromConversion="SquareMillimeter", ToConversion="SquareMeter")
setParameterByName = Element.SetParameterByName(element=code_block_2, parameterName=code_block_3, value=convert_between_units)

# group: WD elements (Opening)
string_from_object_2 = FromObject(obj=select_model_elements)
code_block_7 = CodeBlock { "WD"; }
# note: Filter Opening
contains_2 = String.Contains(str=string_from_object_2, searchFor=code_block_7)
filterByBoolMask_3 = List.FilterByBoolMask(list=select_model_elements, mask=contains_2)

# group: Classify structural wall and beam, slab, column
getCategory_2 = Element.GetCategory(element=filterByBoolMask_3.out)
string_from_object_3 = FromObject(obj=getCategory_2)
code_block_8 = CodeBlock { "Stairs"; }
contains_3 = String.Contains(str=string_from_object_3, searchFor=code_block_8)
# note: Eliminate Stairs
filterByBoolMask_4 = List.FilterByBoolMask(list=filterByBoolMask_3.out, mask=contains_3)
getCategory_3 = Element.GetCategory(element=filterByBoolMask_4.out)
string_from_object_4 = FromObject(obj=getCategory_3)
code_block_9 = CodeBlock { "Structural Foundations"; }
contains_4 = String.Contains(str=string_from_object_4, searchFor=code_block_9)
# note: Eliminate foundation
filterByBoolMask_5 = List.FilterByBoolMask(list=filterByBoolMask_4.out, mask=contains_4)
getCategory_4 = Element.GetCategory(element=filterByBoolMask_5.out)
string_from_object_5 = FromObject(obj=getCategory_4)
code_block_10 = CodeBlock { "Walls"; }
contains_5 = String.Contains(str=string_from_object_5, searchFor=code_block_10)
filterByBoolMask_6 = List.FilterByBoolMask(list=filterByBoolMask_5.out, mask=contains_5)

# group: Foundation plate formwork model
number = DoubleInput(20)
boolean_2 = BoolSelector(false)
thicken = Surface.Thicken(surface=code_block_6, thickness=number, both_sides=boolean_2)
categories = Categories("OST_GenericModel")
string = StringInput("Default")
byName = Material.ByName(name=string)
string_2 = StringInput("Formwork")
byGeometry = DirectShape.ByGeometry(geometry=thicken, category=categories, material=byName, name=string_2)

# group: Assign formwork area to Foundation plate model
code_block_11 = CodeBlock { "Area Formwork"; }
convert_between_units_2 = DynamoConvert(area, MeasurementType="Area", FromConversion="SquareMillimeter", ToConversion="SquareMeter")
setParameterByName_2 = Element.SetParameterByName(element=byGeometry, parameterName=code_block_11, value=convert_between_units_2)
code_block_12 = CodeBlock { "Type"; }
code_block_13 = CodeBlock { "Foundation Form"; }
setParameterByName_3 = Element.SetParameterByName(element=setParameterByName_2, parameterName=code_block_12, value=code_block_13)

# group: STAIR
getCategory_5 = Element.GetCategory(element=select_model_elements)
string_from_object_6 = FromObject(obj=getCategory_5)
code_block_14 = CodeBlock { "Stairs"; }
contains_6 = String.Contains(str=string_from_object_6, searchFor=code_block_14)
# note: Stair and Landing
filterByBoolMask_7 = List.FilterByBoolMask(list=select_model_elements, mask=contains_6)
code_block_15 = CodeBlock(List_stair=filterByBoolMask_7.in) { List_stair; }
code_block_16 = CodeBlock { "Area Formwork"; }
geometry_2 = Element.Geometry(element=filterByBoolMask_7.in)
flatten = List.Flatten(list=geometry_2)
code_block_17 = CodeBlock { "Solid"; }
code_block_18 = CodeBlock { 0.5; }
ZAxis_2 = Vector.ZAxis()
code_block_19 = CodeBlock { 0.5; }
code_block_20 = CodeBlock { 1; }

# group: WALL
# note: Lấy đối tượng tường
code_block_21 = CodeBlock(Walll=filterByBoolMask_6.in) { Walll; }
code_block_22 = CodeBlock { "Area Formwork"; }
geometry_3 = Element.Geometry(element=code_block_21)
code_block_23 = CodeBlock { "Solid"; }
removeIfNot_2 = List.RemoveIfNot(list=geometry_3@L2, type=code_block_23)
flatten_2 = List.Flatten(list=removeIfNot_2)
code_block_24 = CodeBlock(a=filterByBoolMask_3.in) { a; }
geometry_4 = Element.Geometry(element=code_block_24)
flatten_3 = List.Flatten(list=geometry_4)
explode_2 = Geometry.Explode(geometry=flatten_3)
code_block_25 = CodeBlock { 0.5; }
pointAtParameter = Surface.PointAtParameter(surface=explode_2, u=code_block_25, v=code_block_25)
normalAtPoint = Surface.NormalAtPoint(surface=explode_2, point=pointAtParameter)
ZAxis_3 = Vector.ZAxis()
isParallel_2 = Vector.IsParallel(vector=normalAtPoint, other=ZAxis_3)
filterByBoolMask_8 = List.FilterByBoolMask(list=explode_2, mask=isParallel_2)
code_block_26 = CodeBlock(a=filterByBoolMask_8.in) { a; }
flatten_4 = List.Flatten(list=code_block_26)
code_block_27 = CodeBlock { "Solid"; }
code_block_28 = CodeBlock { "Surface"; }
code_block_29 = CodeBlock { 0.5; }
ZAxis_4 = Vector.ZAxis()

# group: Structure elements which doesn't contain wall. stair and foundation
# note: Lấy đối tượng không phải tường
code_block_30 = CodeBlock(Not_Wall_Stair_Foundation=filterByBoolMask_6.out) { Not_Wall_Stair_Foundation; }
code_block_31 = CodeBlock { "Area Formwork"; }
geometry_5 = Element.Geometry(element=code_block_30)
list_create = List.Create(item0=code_block_21, item1=code_block_30)
geometry_6 = Element.Geometry(element=list_create)
code_block_32 = CodeBlock { "Solid"; }
removeIfNot_3 = List.RemoveIfNot(list=geometry_6@L2, type=code_block_32)
flatten_5 = List.Flatten(list=removeIfNot_3)
byUnion = Solid.ByUnion(solids=flatten_5)
explode_3 = Geometry.Explode(geometry=byUnion)
code_block_33 = CodeBlock { 0.5; }
normalAtParameter_2 = Surface.NormalAtParameter(surface=explode_3, u=code_block_33, v=code_block_33)
ZAxis_5 = Vector.ZAxis()
isParallel_3 = Vector.IsParallel(vector=normalAtParameter_2, other=ZAxis_5)
filterByBoolMask_9 = List.FilterByBoolMask(list=explode_3, mask=isParallel_3)
code_block_34 = CodeBlock(horizontal_surafe=filterByBoolMask_9.in) { horizontal_surafe; }
code_block_35 = CodeBlock { 0.5; }
pointAtParameter_2 = Surface.PointAtParameter(surface=code_block_34, u=code_block_35, v=code_block_35)
Z = Point.Z(point=pointAtParameter_2)
groupByKey = List.GroupByKey(list=code_block_34, keys=Z)
sortByKey = List.SortByKey(list=groupByKey.groups, keys=groupByKey.unique_keys)
restOfItems = List.RestOfItems(list=sortByKey.sorted_list)
reverse = List.Reverse(list=restOfItems)
restOfItems_2 = List.RestOfItems(list=reverse)
flatten_6 = List.Flatten(list=restOfItems_2)
code_block_36 = CodeBlock(size_surface=filterByBoolMask_9.out) { size_surface; }
list_create_2 = List.Create(item0=flatten_6, item1=code_block_36)
flatten_7 = List.Flatten(list=list_create_2)
byJoinedSurfaces = PolySurface.ByJoinedSurfaces(surfaces=flatten_7)

# group (continued): STAIR
list_create_3 = List.Create(item0=code_block_21, item1=code_block_30, item2=code_block_15)
flatten_8 = List.Flatten(list=list_create_3)
geometry_7 = Element.Geometry(element=flatten_8)
flatten_9 = List.Flatten(list=geometry_7)
removeIfNot_4 = List.RemoveIfNot(list=flatten_9, type=code_block_17)
byUnion_2 = Solid.ByUnion(solids=removeIfNot_4)
explode_4 = Geometry.Explode(geometry=byUnion_2)
normalAtParameter_3 = Surface.NormalAtParameter(surface=explode_4, u=code_block_18, v=code_block_18)
isParallel_4 = Vector.IsParallel(vector=normalAtParameter_3, other=ZAxis_2)
filterByBoolMask_10 = List.FilterByBoolMask(list=explode_4, mask=isParallel_4)
code_block_37 = CodeBlock(top_bottom=filterByBoolMask_10.in) { top_bottom; }
normalAtParameter_4 = Surface.NormalAtParameter(surface=code_block_37, u=code_block_19, v=code_block_19)
Z_2 = Vector.Z(vector=normalAtParameter_4)
eq = Z_2 == code_block_20
filterByBoolMask_11 = List.FilterByBoolMask(list=code_block_37, mask=eq)
code_block_38 = CodeBlock(bottom_surface=filterByBoolMask_11.out) { bottom_surface; }
code_block_39 = CodeBlock(Side=filterByBoolMask_10.out) { Side; }
list_create_4 = List.Create(item0=code_block_38, item1=code_block_39)
flatten_10 = List.Flatten(list=list_create_4)
byJoinedSurfaces_2 = PolySurface.ByJoinedSurfaces(surfaces=flatten_10)
intersect = Geometry.Intersect(geometry=flatten, other=byJoinedSurfaces_2)
code_block_40 = CodeBlock(Stair_calculation=intersect) { Stair_calculation; }
area_2 = Surface.Area(surface=code_block_40)
sum_2 = Math.Sum(values=area_2)
round_2 = Math.Round(number=sum_2)
convert_between_units_3 = DynamoConvert(round_2, MeasurementType="Area", FromConversion="SquareMillimeter", ToConversion="SquareMeter")
setParameterByName_4 = Element.SetParameterByName(element=code_block_15, parameterName=code_block_16, value=convert_between_units_3)

# group (continued): WALL
list_create_5 = List.Create(item0=code_block_21, item1=code_block_30)
geometry_8 = Element.Geometry(element=list_create_5)
removeIfNot_5 = List.RemoveIfNot(list=geometry_8@L2, type=code_block_27)
flatten_11 = List.Flatten(list=removeIfNot_5)
byUnion_3 = Solid.ByUnion(solids=flatten_11)
explode_5 = Geometry.Explode(geometry=byUnion_3)
intersect_2 = Geometry.Intersect(geometry=flatten_4, other=explode_5, lacing=CrossProduct)
removeIfNot_6 = List.RemoveIfNot(list=intersect_2@L2, type=code_block_28)
flatten_12 = List.Flatten(list=removeIfNot_6)
code_block_41 = CodeBlock(horizontal_surface=flatten_12) { horizontal_surface; }
normalAtParameter_5 = Surface.NormalAtParameter(surface=explode_5, u=code_block_29, v=code_block_29)
isParallel_5 = Vector.IsParallel(vector=normalAtParameter_5, other=ZAxis_4)
filterByBoolMask_12 = List.FilterByBoolMask(list=explode_5, mask=isParallel_5)
code_block_42 = CodeBlock(side_surface=filterByBoolMask_12.out) { side_surface; }
list_create_6 = List.Create(item0=code_block_41, item1=code_block_42)
flatten_13 = List.Flatten(list=list_create_6)
byJoinedSurfaces_3 = PolySurface.ByJoinedSurfaces(surfaces=flatten_13)
intersect_3 = Geometry.Intersect(geometry=flatten_2, other=byJoinedSurfaces_3)
code_block_43 = CodeBlock(Structure_wall=intersect_3) { Structure_wall; }
area_3 = Surface.Area(surface=code_block_43)
sum_3 = Math.Sum(values=area_3)
convert_between_units_4 = DynamoConvert(sum_3, MeasurementType="Area", FromConversion="SquareMillimeter", ToConversion="SquareMeter")
setParameterByName_5 = Element.SetParameterByName(element=code_block_21, parameterName=code_block_22, value=convert_between_units_4)

flatten_14 = List.Flatten(list=geometry_5)

# group (continued): Structure elements which doesn't contain wall. stair and foundation
intersect_4 = Geometry.Intersect(geometry=flatten_14, other=byJoinedSurfaces)
code_block_44 = CodeBlock(Structure_element=intersect_4) { Structure_element; }
area_4 = Surface.Area(surface=code_block_44)
sum_4 = Math.Sum(values=area_4)
convert_between_units_5 = DynamoConvert(sum_4, MeasurementType="Area", FromConversion="SquareMillimeter", ToConversion="SquareMeter")
setParameterByName_6 = Element.SetParameterByName(element=code_block_30, parameterName=code_block_31, value=convert_between_units_5)

# group: Wall formwork plate model
number_2 = DoubleInput(20)
boolean_3 = BoolSelector(false)
thicken_2 = Surface.Thicken(surface=code_block_43, thickness=number_2, both_sides=boolean_3)
categories_2 = Categories("OST_GenericModel")
string_3 = StringInput("Default")
byName_2 = Material.ByName(name=string_3)
string_4 = StringInput("Formwork")
byGeometry_2 = DirectShape.ByGeometry(geometry=thicken_2, category=categories_2, material=byName_2, name=string_4)

# group: Assign area to formwork plate model
code_block_45 = CodeBlock { "Area Formwork"; }
convert_between_units_6 = DynamoConvert(area_3, MeasurementType="Area", FromConversion="SquareMillimeter", ToConversion="SquareMeter")
setParameterByName_7 = Element.SetParameterByName(element=byGeometry_2, parameterName=code_block_45, value=convert_between_units_6)
code_block_46 = CodeBlock { "Type"; }
code_block_47 = CodeBlock { "Wall Form"; }
setParameterByName_8 = Element.SetParameterByName(element=byGeometry_2, parameterName=code_block_46, value=code_block_47)

# group: Beam formwork plate model
getCategory_6 = Element.GetCategory(element=select_model_elements)
string_from_object_7 = FromObject(obj=getCategory_6)
code_block_48 = CodeBlock { "Structural Framing"; }
contains_7 = String.Contains(str=string_from_object_7, searchFor=code_block_48)
filterByBoolMask_13 = List.FilterByBoolMask(list=select_model_elements, mask=contains_7)
code_block_49 = CodeBlock(Beam=filterByBoolMask_13.in) { Beam; }
geometry_9 = Element.Geometry(element=code_block_49)
flatten_15 = List.Flatten(list=geometry_9)
intersect_5 = Geometry.Intersect(geometry=flatten_15, other=byJoinedSurfaces)
code_block_50 = CodeBlock(Beam=intersect_5) { Beam; }
number_3 = DoubleInput(20)
boolean_4 = BoolSelector(false)
thicken_3 = Surface.Thicken(surface=code_block_50, thickness=number_3, both_sides=boolean_4)
categories_3 = Categories("OST_GenericModel")
string_5 = StringInput("Default")
byName_3 = Material.ByName(name=string_5)
string_6 = StringInput("Formwork")
byGeometry_3 = DirectShape.ByGeometry(geometry=thicken_3, category=categories_3, material=byName_3, name=string_6)
code_block_51 = CodeBlock { "Area Formwork"; }
area_5 = Surface.Area(surface=code_block_50)
convert_between_units_7 = DynamoConvert(area_5, MeasurementType="Area", FromConversion="SquareMillimeter", ToConversion="SquareMeter")
setParameterByName_9 = Element.SetParameterByName(element=byGeometry_3, parameterName=code_block_51, value=convert_between_units_7)
code_block_52 = CodeBlock { "Type"; }
code_block_53 = CodeBlock { "Beam Form"; }
setParameterByName_10 = Element.SetParameterByName(element=setParameterByName_9, parameterName=code_block_52, value=code_block_53)

# group: Stair formwork plate model
number_4 = DoubleInput(20)
boolean_5 = BoolSelector(false)
thicken_4 = Surface.Thicken(surface=code_block_40, thickness=number_4, both_sides=boolean_5)
categories_4 = Categories("OST_GenericModel")
string_7 = StringInput("Default")
byName_4 = Material.ByName(name=string_7)
string_8 = StringInput("Formwork")
byGeometry_4 = DirectShape.ByGeometry(geometry=thicken_4, category=categories_4, material=byName_4, name=string_8)

# group: Assign formwork area to Stair plate model
code_block_54 = CodeBlock { "Area Formwork"; }
convert_between_units_8 = DynamoConvert(area_2, MeasurementType="Area", FromConversion="SquareMillimeter", ToConversion="SquareMeter")
setParameterByName_11 = Element.SetParameterByName(element=byGeometry_4, parameterName=code_block_54, value=convert_between_units_8)
code_block_55 = CodeBlock { "Type"; }
code_block_56 = CodeBlock { "Stair Form"; }
setParameterByName_12 = Element.SetParameterByName(element=setParameterByName_11, parameterName=code_block_55, value=code_block_56)

# group: Column formwork plate model
getCategory_7 = Element.GetCategory(element=select_model_elements)
string_from_object_8 = FromObject(obj=getCategory_7)
code_block_57 = CodeBlock { "Columns"; }
contains_8 = String.Contains(str=string_from_object_8, searchFor=code_block_57)
filterByBoolMask_14 = List.FilterByBoolMask(list=select_model_elements, mask=contains_8)
code_block_58 = CodeBlock(Columns=filterByBoolMask_14.in) { Columns; }
geometry_10 = Element.Geometry(element=code_block_58)
flatten_16 = List.Flatten(list=geometry_10)
intersect_6 = Geometry.Intersect(geometry=flatten_16, other=byJoinedSurfaces)
code_block_59 = CodeBlock(Columns=intersect_6) { Columns; }
number_5 = DoubleInput(20)
boolean_6 = BoolSelector(false)
thicken_5 = Surface.Thicken(surface=code_block_59, thickness=number_5, both_sides=boolean_6)
categories_5 = Categories("OST_GenericModel")
string_9 = StringInput("Default")
byName_5 = Material.ByName(name=string_9)
string_10 = StringInput("Formwork")
byGeometry_5 = DirectShape.ByGeometry(geometry=thicken_5, category=categories_5, material=byName_5, name=string_10)
code_block_60 = CodeBlock { "Area Formwork"; }
area_6 = Surface.Area(surface=code_block_59)
convert_between_units_9 = DynamoConvert(area_6, MeasurementType="Area", FromConversion="SquareMillimeter", ToConversion="SquareMeter")
setParameterByName_13 = Element.SetParameterByName(element=byGeometry_5, parameterName=code_block_60, value=convert_between_units_9)
code_block_61 = CodeBlock { "Type"; }
code_block_62 = CodeBlock { "Column Form"; }
setParameterByName_14 = Element.SetParameterByName(element=setParameterByName_13, parameterName=code_block_61, value=code_block_62)

# group: Slab formwork plate model
getCategory_8 = Element.GetCategory(element=select_model_elements)
string_from_object_9 = FromObject(obj=getCategory_8)
code_block_63 = CodeBlock { "Floors"; }
contains_9 = String.Contains(str=string_from_object_9, searchFor=code_block_63)
filterByBoolMask_15 = List.FilterByBoolMask(list=select_model_elements, mask=contains_9)
code_block_64 = CodeBlock(Slab=filterByBoolMask_15.in) { Slab; }
geometry_11 = Element.Geometry(element=code_block_64)
flatten_17 = List.Flatten(list=geometry_11)
intersect_7 = Geometry.Intersect(geometry=flatten_17, other=byJoinedSurfaces)
code_block_65 = CodeBlock(Slab=intersect_7) { Slab; }
number_6 = DoubleInput(20)
boolean_7 = BoolSelector(false)
thicken_6 = Surface.Thicken(surface=code_block_65, thickness=number_6, both_sides=boolean_7)
categories_6 = Categories("OST_GenericModel")
string_11 = StringInput("Default")
byName_6 = Material.ByName(name=string_11)
string_12 = StringInput("Formwork")
byGeometry_6 = DirectShape.ByGeometry(geometry=thicken_6, category=categories_6, material=byName_6, name=string_12)
code_block_66 = CodeBlock { "Area Formwork"; }
area_7 = Surface.Area(surface=code_block_65)
convert_between_units_10 = DynamoConvert(area_7, MeasurementType="Area", FromConversion="SquareMillimeter", ToConversion="SquareMeter")
setParameterByName_15 = Element.SetParameterByName(element=byGeometry_6, parameterName=code_block_66, value=convert_between_units_10)
code_block_67 = CodeBlock { "Type"; }
code_block_68 = CodeBlock { "Slab Form"; }
setParameterByName_16 = Element.SetParameterByName(element=setParameterByName_15, parameterName=code_block_67, value=code_block_68)
